# Grasshopper definition Mallard2Test.ghx (Grasshopper 1.0.7)
# plug-ins: Mallard2

# Public Test Airtable Base
panel = Panel("https://airtable.com/shrGY1vaiH3iQaVaC")

list_airtable_records = ListAirtableRecords(BaseID="appsj7ZSiHOfUvzXk", AppKey="keyjxzgBUonIj836P", TableName="Table 2", ViewName="Grid view")  # -> ErrorMessage, OutRecords

merge = Merge(
    Data1="Name",
    Data2="Notes",
    Data3="Attachments",
    Data4="Status",
    Data5="multi",
    Data6="check",
    Data7="Collaborators",
    Data8="Date",
    Data9="barcode",
    Data10="Rating",
    Data11="URL",
    Data12="Departments",
    Data13="Notes (from Departments)")
airtable_record_fields = AirtableRecordFields(Records=list_airtable_records.OutRecords, FieldName=graft(merge))
panel_2 = Panel(airtable_record_fields)

list_item = ListItem(List=list_airtable_records.OutRecords, Index=Slider(4, range=0..10), Wrap=True)
delete_airtable_records = DeleteAirtableRecords(
    Refresh=Toggle(False),
    BaseID="appsj7ZSiHOfUvzXk",
    AppKey="keyjxzgBUonIj836P",
    TableName="Table 2",
    RecordObject=list_item)  # -> ErrorMessage, OutRecord
panel_3 = Panel(delete_airtable_records.OutRecord)
panel_4 = Panel(delete_airtable_records.ErrorMessage)

# ----
# big, tall, athletic, impressive
number_slider = Slider(8, range=0..10)
series = Series(Start=0, Step=1, Count=number_slider)
update_airtable_record = UpdateAirtableRecord(
    Refresh=Toggle(False),
    BaseID="appsj7ZSiHOfUvzXk",
    AppKey="keyjxzgBUonIj836P",
    TableName="Table 2",
    RecordObject=list_airtable_records.OutRecords,
    FieldName="Notes",
    FieldValue=series)  # -> ErrorMessage, OutRecord
panel_5 = Panel(update_airtable_record.ErrorMessage)
panel_6 = Panel(update_airtable_record.OutRecord)

create_airtable_records = CreateAirtableRecords(
    Toggle=Toggle(False),
    BaseID="appsj7ZSiHOfUvzXk",
    AppKey="keyjxzgBUonIj836P",
    TableName="Table 2",
    FieldNames="Name",
    Fields="Nicholas")  # -> ErrorMessage, OutRecords
panel_7 = Panel(create_airtable_records.OutRecords)
panel_8 = Panel(create_airtable_records.ErrorMessage)
